# Grasshopper definition extrusion example.gh (Grasshopper 0.9.76)
# plug-ins: Robots

base_coordinates = Panel("""1889.23,872.96,109.58
725.10,805.27,100.95
880.59,-333.91,97.27""")

# ---- group: extrusion attributes
# geometry
# to contour
extrusion_width = Panel("12")
layer_height = Panel("6")
mesh = Mesh(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)

# ---- group: target attributes
zones = Panel("""20
2
0""")
speeds = Panel("""500
150
60""")

# ---- group: end effector
# tcp
# tool oriented sideways
# to avoid wrist singularity
# tool geometry
# index of digital output
#  that turns on and of
# the extruder
panel = Panel("0,0,1")
tool_weight = Panel("6.0")
do_index = Panel("0")
pt = Point(Point(137.8363948, 2.467293384e-06, 44.59797803))
mesh_2 = Mesh(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)
tool_name = Panel("Extruder")
pl = ConstructPlane(Origin=pt, XAxis="0,1,0", YAxis=panel)
tool = CreateTool(Name=tool_name, TCP=pl, Weight=tool_weight, Mesh=mesh_2)  # -> Tool, TCP

# ---- group: extrusion base
# 3 point calibration
# for base of extrusion
pt_2 = Point(base_coordinates)

# ----
# select robot
list = ValueList({"ABB.IRB120", "ABB.IRB1600-145", "KUKA.KR6-R900", "KUKA.KR60-HA", "KUKA.KR210-2", "UR.UR10"}, selected="ABB.IRB1600-145")
loadrobot = LoadRobot(Model=list, Base=PlaneXY(0, 0, 0), FromFile=False)

# ----
# If the same speed or zone is used on
# different "create target" components, convert
#  them first to a speed or zone parameter.
speed = SpeedParameter(speeds)
zone = ZoneParameter(zones)

# ---- group: base plane
item = ListItem(List=pt_2, Index=0, Wrap=True)  # -> Item, Item1, Item2
pl_3pt = Plane3Pt(PointA=item.Item1, PointB=item.Item2, PointC=item.Item)

# ---- group: base surface
item_2 = ListItem(List=pt_2, Index=0, Wrap=True)  # -> Item, Item1, Item2
dist = Distance(PointA=item_2.Item, PointB=item_2.Item1)
dist_2 = Distance(PointA=item_2.Item1, PointB=item_2.Item2)
planesrf = PlaneSurface(Plane=pl_3pt, XSize=dist_2, YSize=dist)

# ---- group: create contours
contour = Contour(Shape=mesh, Point=Point(0, 0, 0), Direction=Vector(0, 0, 1), Distance=layer_height)
simplify = SimplifyCurve(Curve=contour, Tolerance=extrusion_width, AngleTolerance="pi/32")  # -> Curve, Simplified

# ----
pl_offset = PlaneOffset(BasePlane=pl_3pt, Offset=layer_height)

# ---- group: orient contours to base
orient = Orient(Geometry=simplify.Curve, Source=PlaneXY(0, 0, 0), Target=pl_offset)  # -> Geometry, Transform

# ---- group: get target locations
cp = ControlPoints(Curve=orient.Geometry)  # -> Points, Weights, Knots

# ---- group: create target orientations
rev = Reverse(Vector=pl_3pt)
rev_2 = Reverse(Vector=cp.Points)
pl_2 = PlaneNormal(Origin=cp.Points, ZAxis=rev)
align = AlignPlane(Plane=pl_2, Direction=rev_2)  # -> Plane, Angle

# ----
panel_2 = Panel(align.Plane)
item_3 = ListItem(List=speed, Index=0, Wrap=True)  # -> Item, Item1, Item2
item_4 = ListItem(List=zone, Index=0, Wrap=True)  # -> Item, Item1, Item2

# ---- group: extrusion targets
list_2 = ValueList({"Joint", "Linear"}, selected="Linear")
target = CreateTarget(Plane=align.Plane, Motion=list_2, Tool=tool.Tool, Speed=item_3.Item2, Zone=item_4.Item1, IsCartesian=True)

# ---- group: home position
target_2 = CreateTarget(Joints="0,pi/2,0,pi/2,-pi/2,-pi/2", Tool=tool.Tool, Speed=item_3.Item, Zone=item_4.Item, IsCartesian=False)

# ---- group: replace attributes on first and last targets of each contour
# Commands are added at the first and last targets of
# each contour to turn the extruder on and off.
# Aproximation zone is set to 0 to sync the commands
# with the position of the robot.
# The speed to the first target is changed to the
# approach speed.
panel_3 = Panel("""0
-1""")
panel_4 = Panel("""true
false""")
panel_5 = Panel("""1
2""")
item_5 = ListItem(List=target, Index=panel_3, Wrap=True)
setdo = SetDO(DO=do_index, Value=panel_4)
item_6 = ListItem(List=speed, Index=panel_5, Wrap=True)
target_3 = CreateTarget(Target=item_5, Speed=item_6, Zone=item_4.Item2, Command=setdo, IsCartesian=True)
panel_6 = Panel("""0
-2""")
replace = ReplaceItems(List=target, Item=target_3, Indices=panel_6, Wrap=True)

# ---- group: add approach targets
# Adds a target just above the start and end
# targets of each contour. This allows the
# extruder to move quickly to the start of another
# contour without colliding with what has been
# extruded already.
target_4 = TargetParameter(item_5)
expression = Expression(x=layer_height, Expression="-x*1.5")
detarget = DeconstructTarget(Target=target_4)
panel_7 = Panel("""0
1""")
pl_offset_2 = PlaneOffset(BasePlane=detarget, Offset=expression)
item_7 = ListItem(List=speed, Index=panel_7, Wrap=True)
target_5 = CreateTarget(Target=target_4, Plane=pl_offset_2, Speed=item_7, IsCartesian=True)
panel_8 = Panel("""0
-1""")
ins = InsertItems(List=replace, Item=target_5, Indices=panel_8, Wrap=True)

# ---- group: flatten targets and add home position
target_6 = TargetParameter(flatten(ins))
panel_9 = Panel("""0
-1""")
ins_2 = InsertItems(List=target_6, Item=target_2, Indices=panel_9, Wrap=True)

# ---- group: create robot program
program_name = Panel("Extrusion")
program = CreateProgram(Name=program_name, Robot=loadrobot, Targets=ins_2, StepSize="100")  # -> Program, Code, Duration, Warnings, Errors

# ---- group: simulate tool path
# Right click and select
# "open controls", or move
#  the control knob.
knob = ControlKnob(Decimals=5, Limit=True, Maximum=1, Minimum=0, Range=0.1, Value=0.51771)
sim = ProgramSimulation(Program=program.Program, Time=knob, Normalized=True)  # -> RobotMeshes, JointRotations, Plane, Index, Time, Program, Errors

# ---- group: display extruded contours
no_segments = Panel("20")
c_script = CSharpScript(
    P=sim.Program,
    D=do_index,
    H=layer_height,
    W=extrusion_width,
    S=no_segments,
    Reference="C:\Users\vicente\AppData\Roaming\Grasshopper\Libraries\Robots.gha")  # -> out, A; inputs D: Int32, H: Double, W: Double, S: Int32
# ---------- c_script: C# ----------
    Program newProgram = P as Program;
    if (newProgram != program)
    {
      program = newProgram;
      height = H / 2;
      width = W / 2;
      segments = S;
      CreateContours(D);
    }

    var extrudedContours = contours.Where(x => x.End <= program.CurrentSimulationTarget.Index).Select(x => x.Mesh).ToList();
    var currentContour = contours.FirstOrDefault(x => x.Start < program.CurrentSimulationTarget.Index && x.End > program.CurrentSimulationTarget.Index);

    if (currentContour != null)
    {
      var polyline = new Polyline();
      polyline.AddRange(currentContour.Polyline.GetRange(0, program.CurrentSimulationTarget.Index - currentContour.Start));
      polyline.Add(program.CurrentSimulationTarget.Plane.Origin);
      var mesh = MeshPolyline(polyline);
      extrudedContours.Add(mesh);
    }
    A = extrudedContours;
# ---------- c_script: C# additional code ----------
  Program program = null;
  double height;
  double width;
  int segments;
  List<Contour> contours;

  class Contour
  {
    public int Start {get;set;}
    public int End {get;set;}
    public Polyline Polyline {get;set;}
    public Mesh Mesh {get;set;}

    public Contour()
    {
      Polyline = new Polyline();
    }
  }

  void CreateContours(int DO)
  {
    contours = new List<Contour>();

    Contour contour = null;

    foreach(var target in program.Targets)
    {
      if (contour != null) contour.Polyline.Add(target.Plane.Origin);

      var setDOs = target.Commands.Flatten()
        .OfType<Robots.Commands.SetDO>()
        .Where(x => x.DO == DO);

      if (setDOs.Count() > 0)
      {
        if (setDOs.Last().Value)
        {
          if (contour == null)
          {
            contour = new Contour();
            contour.Polyline.Add(target.Plane.Origin);
            contour.Start = target.Index;
          }
        }
        else if (contour != null)
        {
          contour.Mesh = MeshPolyline(contour.Polyline);
          contour.End = target.Index;
          contours.Add(contour);
          contour = null;
        }
      }
    }
  }

  Mesh MeshPolyline(Polyline polyline)
  {
    var profile = new List<Point3d>();
    for(int i = 0;i < segments;i++)
    {
      double angle = i * Math.PI * 2 / segments;
      profile.Add(new Point3d(Math.Cos(angle) * width, Math.Sin(angle) * height, 0));
    }

    var points = new List<Point3d>();
    var planes = new List<Plane>();

    for(int i = 0;i < polyline.Count;i++)
    {
      Vector3d vector;
      if (i == 0) vector = polyline[1] - polyline[0];
      else if (i == polyline.Count - 1) vector = polyline[polyline.Count - 1] - polyline[polyline.Count - 2];
      else vector = (polyline[i + 1] - polyline[i]) + (polyline[i] - polyline[i - 1]);

      var plane = new Plane(polyline[i] - Vector3d.ZAxis * height, vector, Vector3d.ZAxis);
      planes.Add(new Plane(plane.Origin, plane.ZAxis, plane.YAxis));
    }

    bool isClosed = Math.Abs(polyline[0].DistanceTo(polyline[polyline.Count - 1])) < RhinoDocument.ModelAbsoluteTolerance;
    if (isClosed) planes.RemoveAt(planes.Count - 1);

    foreach(Plane plane in planes)
    {
      foreach(Point3d point in profile)
        points.Add(plane.PointAt(point.X, point.Y));
    }

    var faces = new List<MeshFace>();

    int count = isClosed ? points.Count : points.Count - segments;

    for(int i = 0;i < count;i++)
    {
      int k = i + 1;
      int j = ((k) % segments == 0) ? k - segments : k;

      int sj = j + segments;
      int si = i + segments;
      if (i >= points.Count - segments)
      {
        sj -= points.Count;
        si -= points.Count;
      }

      faces.Add(new MeshFace(i, j, sj, si));
    }

    Mesh mesh = new Mesh();
    mesh.Vertices.AddVertices(points);
    mesh.Faces.AddFaces(faces);
    mesh.Normals.ComputeNormals();
    return mesh;
  }
# ---------- end c_script ----------

# ----
split = SplitList(List=sim.RobotMeshes, Index="7")  # -> ListA, ListB

# ---- group: display geometry
preview = CustomPreview(Geometry=planesrf, Shader=ColourSwatch(SwatchColor=RGB(38, 38, 38)))
preview_2 = CustomPreview(Geometry=split.ListA, Shader=ColourSwatch(SwatchColor=RGB(212, 85, 0)))
preview_3 = CustomPreview(Geometry=split.ListB, Shader=ColourSwatch(SwatchColor=RGB(113, 114, 120)))
preview_4 = CustomPreview(Geometry=c_script.A, Shader=ColourSwatch(SwatchColor=RGB(194, 167, 149)))

# ----
robot_program = Panel(program.Code)
