# Grasshopper definition Python script example.gh (Grasshopper 1.0.7)
# plug-ins: Robots

list = RobotsLibrary(
    {"Bartlett-IRB120", "Bartlett-IRB1600", "Bartlett-KR6", "Bartlett-KR60-A", "Bartlett-KR60-B", "Bartlett-KR500", "Bartlett-KR60 on track", "Bartlett-UR10", "Bartlett-KR60", "Bartlett-TX200", "Bartlett-TX200L", "Bartlett-RX160", "Bartlett-RX160L", "Nagami Multimove", "Nagami IRB6700", "Nagami IRB4600", "Nagami IRB6640", "TTDA-KR6", "TTDA-KR60", "TTDA-IIWA14", "Penn-IRB120", "Penn-IRB4600-60", "Penn-IRB4600-60 + Track", "uem-IRB120", "uem-IRB1600", "uem-IRB2600", "uem-IRB1600_IRB2600"}, selected="Bartlett-IRB120",
    Type=0)
loadrobot = LoadRobotSystem(Name=list, Base=PlaneXY(0, 0, 0))
python = GhPythonScript(R=loadrobot)  # -> P, W
# ---------- python: Python ----------
import clr
clr.AddReference("Robots.dll")

from Rhino.Geometry import Point3d, Plane
from Robots import *

pa = Plane.WorldYZ
pb = Plane.WorldYZ
pa.Origin = Point3d(300, 200, 610)
pb.Origin = Point3d(300, -200, 610)

toolpath = SimpleToolpath([
CartesianTarget(pa, RobotConfigurations.Wrist, Motions.Joint),
CartesianTarget(pb, None, Motions.Linear, speed = Speed(300))
])

P = Program("TestProgram", R, [toolpath])
W = P.Warnings
# ---------- end python ----------
program_warnings = Panel(python.W)
sim = ProgramSimulation(Program=python.P, Time=Slider(0, range=0..1), Normalized=True)  # -> SystemMeshes, JointRotations, Plane, Index, Time, Program, Errors
