# Grasshopper definition extrusion-example.gh (Grasshopper 1.0.8)
# plug-ins: Robots

base_coordinates = Panel("""1489.23,472.96,109.58
725.10,405.27,100.95
880.59,-433.91,97.27""")
list = RobotsLibrary(
    {"Franka Emika Panda", "Bartlett-IRB120", "Bartlett-IRB1600", "Bartlett-KR6", "Bartlett-KR60-A", "Bartlett-KR60-B", "Bartlett-KR500", "Bartlett-KR60 on track", "Bartlett-UR10", "Bartlett-KR60", "Bartlett-TX200", "Bartlett-TX200L", "Bartlett-RX160", "Bartlett-RX160L"}, selected="Bartlett-IRB1600",
    Type=0)

# ---- group: extrusion attributes
# geometry
# to contour
extrusion_width = Panel("12")
layer_height = Panel("6")
mesh = Mesh(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)

# ---- group: target attributes
zones = Panel("""20
2
0""")
speeds = Panel("""500
150
60""")

# ---- group: end effector
# tcp
# tool oriented sideways
# to avoid wrist singularity
# tool geometry
# index of digital output
#  that turns on and of
# the extruder
panel = Panel("0,0,1")
tool_weight = Panel("6.0")
do_index = Panel("0")
pt = Point(Point(137.8363948, 2.467293384e-06, 44.59797803))
mesh_2 = Mesh(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)
tool_name = Panel("Extruder")
pl = ConstructPlane(Origin=pt, XAxis="0,1,0", YAxis=panel)
createtool = CreateTool(Name=tool_name, TCP=pl, Weight=tool_weight, Mesh=mesh_2)  # -> Tool, TCP

# ---- group: extrusion base
# 3 point calibration
# for base of extrusion
pt_2 = Point(base_coordinates)

# ----
# If the same speed or zone is used on
# different "create target" components, convert
#  them first to a speed or zone parameter.
speed = SpeedParameter(speeds)
zone = ZoneParameter(zones)

# ---- group: base frame
item = ListItem(List=pt_2, Index=0, Wrap=True)  # -> Item, Item1, Item2
pl_3pt = Plane3Pt(PointA=item.Item1, PointB=item.Item2, PointC=item.Item)
createframe = CreateFrame(Plane=pl_3pt, CoupledMechanicalGroup=-1, CoupledMechanism=-1)

# ---- group: base surface
item_2 = ListItem(List=pt_2, Index=0, Wrap=True)  # -> Item, Item1, Item2
dist = Distance(PointA=item_2.Item, PointB=item_2.Item1)
dist_2 = Distance(PointA=item_2.Item1, PointB=item_2.Item2)
planesrf = PlaneSurface(Plane=pl_3pt, XSize=dist_2, YSize=dist)

# ----
# select robot
loadrobotsystem = LoadRobotSystem(Name=list, Base=PlaneXY(0, 0, 0))

# ---- group: create contours
contour = Contour(Shape=mesh, Point=Point(0, 0, 0), Direction=Vector(0, 0, 1), Distance=layer_height)
simplify = SimplifyCurve(Curve=contour, Tolerance=extrusion_width, AngleTolerance="pi/32")  # -> Curve, Simplified

# ---- group: create target planes
cp = ControlPoints(Curve=simplify.Curve)  # -> Points, Weights, Knots
Z = UnitZ(Factor=layer_height)
addition = Addition(A=cp.Points, B=Z)
pl_2 = ConstructPlane(Origin=addition, XAxis="0,-1,0", YAxis="-1,0,0")

# ----
item_3 = ListItem(List=zone, Index=0, Wrap=True)  # -> Item, Item1, Item2
item_4 = ListItem(List=speed, Index=0, Wrap=True)  # -> Item, Item1, Item2

# ---- group: home position
panel_2 = Panel("0,pi/2,0,pi/2,-pi/2,-pi/2")

# ---- group: extrusion targets
list_2 = ValueList({"Joint", "Linear"}, selected="Linear")

# ----
createtarget = CreateTarget(
    Plane=pl_2,
    Motion=list_2,
    Tool=createtool.Tool,
    Speed=item_4.Item2,
    Zone=item_3.Item1,
    Frame=createframe,
    IsCartesian=True)
createtarget_2 = CreateTarget(Joints=panel_2, Tool=createtool.Tool, Speed=item_4.Item, Zone=item_3.Item, IsCartesian=False)

# ---- group: create robot program
program_name = Panel("Extrusion")
panel_3 = Panel("10")

# ---- group: display extruded contours
no_segments = Panel("20")

# ---- group: replace attributes on first and last targets of each contour
# Commands are added at the first and last targets of
# each contour to turn the extruder on and off.
# Aproximation zone is set to 0 to sync the commands
# with the position of the robot.
# The speed to the first target is changed to the
# approach speed.
panel_4 = Panel("""0
-1""")
panel_5 = Panel("""true
false""")
panel_6 = Panel("""1
2""")
item_5 = ListItem(List=createtarget, Index=panel_4, Wrap=True)
setdo = SetDO(DO=do_index, Value=panel_5)
item_6 = ListItem(List=speed, Index=panel_6, Wrap=True)
panel_7 = Panel("""0
-2""")

# ----
createtarget_3 = CreateTarget(Target=item_5, Speed=item_6, Zone=item_3.Item2, Command=setdo, IsCartesian=True)

# ---- group: replace attributes on first and last targets of each contour (continued)
replace = ReplaceItems(List=createtarget, Item=createtarget_3, Indices=panel_7, Wrap=True)

# ---- group: add approach targets
# Adds a target just above the start and end
# targets of each contour. This allows the
# extruder to move quickly to the start of another
# contour without colliding with what has been
# extruded already.
target = TargetParameter(item_5)
expression = Expression(x=layer_height, Expression="-x*1.5")
panel_8 = Panel("""0
1""")
item_7 = ListItem(List=speed, Index=panel_8, Wrap=True)
panel_9 = Panel("""0
-1""")

# ----
deconstructtarget = DeconstructTarget(Target=target)

# ---- group: add approach targets (continued)
pl_offset = PlaneOffset(BasePlane=deconstructtarget, Offset=expression)

# ----
createtarget_4 = CreateTarget(Target=target, Plane=pl_offset, Speed=item_7, IsCartesian=True)

# ---- group: add approach targets (continued)
ins = InsertItems(List=replace, Item=createtarget_4, Indices=panel_9, Wrap=True)

# ---- group: flatten targets and add home position
target_2 = TargetParameter(flatten(ins))
panel_10 = Panel("""0
-1""")
ins_2 = InsertItems(List=target_2, Item=createtarget_2, Indices=panel_10, Wrap=True)

# ----
createprogram = CreateProgram(Name=program_name, RobotSystem=loadrobotsystem, Targets=ins_2, StepSize=panel_3)  # -> Program, Code, Duration, Warnings, Errors

# ---- group: simulate tool path
# Right click and select
# "open controls", or move
#  the control knob.
knob = ControlKnob(Decimals=5, Limit=True, Maximum=1, Minimum=0, Range=0.1, Value=0.32286)
programsimulation = ProgramSimulation(Program=createprogram.Program, Time=knob, Normalized=True)  # -> SystemMeshes, JointRotations, Plane, Index, Time, Program, Errors

# ----
c_script = CSharpScript(P=programsimulation.Program, D=do_index, H=layer_height, W=extrusion_width, S=no_segments)  # -> out, A
# ---------- c_script: C# ----------
#r "Robots.dll"

using System;
using System.Collections.Generic;
using System.Linq;

using Rhino;
using Rhino.Geometry;

using Grasshopper.Kernel;
using Robots;

public class Script_Instance : GH_ScriptInstance
{
    private Robots.Program _program;
    private List<Contour> _contours = new();
    private double _height;
    private double _width;
    private int _segments;
    private int _digitalOutput;
    private const int Group = 0;

    private void RunScript(
		object P,
		object D,
		object H,
		object W,
		object S,
		ref object A)
    {
        var program = P as Robots.Program;
        int digitalOutput = Convert.ToInt32(D);
        double height = Convert.ToDouble(H);
        double width = Convert.ToDouble(W);
        int segments = Convert.ToInt32(S);

        if (program is null || !program.HasSimulation)
            return;

        if (!ReferenceEquals(program, _program) || digitalOutput != _digitalOutput || height != _height * 2 || width != _width * 2 || segments != _segments)
        {
            _program = program;
            _digitalOutput = digitalOutput;
            _height = height / 2;
            _width = width / 2;
            _segments = segments;
            CreateContours(digitalOutput);
        }

        int index = program.CurrentSimulationPose.TargetIndex;
        var extrudedContours = _contours.Where(x => x.End < index).Select(x => x.Mesh).ToList();
        var currentContour = _contours.FirstOrDefault(x => x.Start < index && x.End >= index);

        if (currentContour is not null)
        {
            var polyline = new Polyline();
            polyline.AddRange(currentContour.Polyline.GetRange(0, index - currentContour.Start));
            polyline.Add(program.CurrentSimulationPose.GetLastPlane(Group).Origin);
            extrudedContours.Add(MeshPolyline(polyline));
        }

        A = extrudedContours;
    }

    private void CreateContours(int digitalOutput)
    {
        _contours = new();
        Contour contour = null;

        foreach (var cellTarget in _program.Targets)
        {
            var target = cellTarget.ProgramTargets[Group];

            if (contour is not null)
                contour.Polyline.Add(target.WorldPlane.Origin);

            var commands = target.Commands
                .OfType<Robots.Commands.SetDO>()
                .Where(x => x.DO == digitalOutput)
                .ToArray();

            if (commands.Length == 0)
                continue;

            if (commands[^1].Value)
            {
                if (contour is null)
                {
                    contour = new Contour();
                    contour.Polyline.Add(target.WorldPlane.Origin);
                    contour.Start = target.Index;
                }
            }
            else if (contour is not null)
            {
                contour.Mesh = MeshPolyline(contour.Polyline);
                contour.End = target.Index;
                _contours.Add(contour);
                contour = null;
            }
        }
    }

    private Mesh MeshPolyline(Polyline polyline)
    {
        var profile = new List<Point3d>();

        for (int i = 0; i < _segments; i++)
        {
            double angle = i * Math.PI * 2 / _segments;
            profile.Add(new Point3d(Math.Cos(angle) * _width, Math.Sin(angle) * _height, 0));
        }

        var points = new List<Point3d>();
        var planes = new List<Plane>();

        for (int i = 0; i < polyline.Count; i++)
        {
            Vector3d vector;

            if (i == 0)
                vector = polyline[1] - polyline[0];
            else if (i == polyline.Count - 1)
                vector = polyline[^1] - polyline[^2];
            else
                vector = (polyline[i + 1] - polyline[i]) + (polyline[i] - polyline[i - 1]);

            var plane = new Plane(polyline[i] - Vector3d.ZAxis * _height, vector, Vector3d.ZAxis);
            planes.Add(new Plane(plane.Origin, plane.ZAxis, plane.YAxis));
        }

        double tolerance = RhinoDocument?.ModelAbsoluteTolerance ?? RhinoMath.ZeroTolerance;
        bool isClosed = Math.Abs(polyline[0].DistanceTo(polyline[^1])) < tolerance;

        if (isClosed)
            planes.RemoveAt(planes.Count - 1);

        foreach (Plane plane in planes)
        {
            foreach (Point3d point in profile)
                points.Add(plane.PointAt(point.X, point.Y));
        }

        var faces = new List<MeshFace>();
        int count = isClosed ? points.Count : points.Count - _segments;

        for (int i = 0; i < count; i++)
        {
            int k = i + 1;
            int j = (k % _segments == 0) ? k - _segments : k;
            int sj = j + _segments;
            int si = i + _segments;

            if (i >= points.Count - _segments)
            {
                sj -= points.Count;
                si -= points.Count;
            }

            faces.Add(new MeshFace(i, j, sj, si));
        }

        Mesh mesh = new();
        mesh.Vertices.AddVertices(points);
        mesh.Faces.AddFaces(faces);
        mesh.Normals.ComputeNormals();
        return mesh;
    }

    private class Contour
    {
        public int Start { get; set; }
        public int End { get; set; }
        public Polyline Polyline { get; } = new();
        public Mesh Mesh { get; set; }
    }
}
# ---------- end c_script ----------
split = SplitList(List=programsimulation.SystemMeshes, Index="7")  # -> ListA, ListB

# ---- group: display geometry
preview = CustomPreview(Geometry=planesrf, Shader=ColourSwatch(SwatchColor=RGB(38, 38, 38)))
preview_2 = CustomPreview(Geometry=split.ListA, Shader=ColourSwatch(SwatchColor=RGB(212, 85, 0)))
preview_3 = CustomPreview(Geometry=split.ListB, Shader=ColourSwatch(SwatchColor=RGB(113, 114, 120)))
preview_4 = CustomPreview(Geometry=c_script.A, Shader=ColourSwatch(SwatchColor=RGB(194, 167, 149)))
