# Grasshopper definition metal-forming-example.gh (Grasshopper 1.0.8)
# plug-ins: Robots

poses_for_4_point_calibration = Panel("""-41.73,-58.55,90.89,-16.56,-33.47,-15.86
-46.72,-55.58,86.40,-35.82,-27.49,41.78
-47.97,-45.74,62.26,-122.72,-45.86,123.78
-29.86,-47.66,84.81,-305.12,-90.76,292.91""")
_3_point_base_calibration = Panel("""1110.65,1283.22,847.93
1199.13,694.70,853.5
1787.65,779.58,856.59""")

# ---- group: optional 4 point calibration for TCP
split = TextSplit(Text=poses_for_4_point_calibration, Separators=",")
degreestoradians = DegreesToRadians(Degrees=split, MechanicalGroup=0)  # -> flatten(Radians)
kinematics = Kinematics(Target=degreestoradians, DisplayGeometry_2=False)  # -> Meshes, Joints, Planes, Errors
pln = Plane()

# ---- group: end effector
tool_name = Panel("BendingTool")
pt = Point(Point(260.75, 0.25, 141.835))
weight = Panel("2.0")
mesh = Mesh(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)
pl = ConstructPlane(Origin=pt, XAxis="0,0,-1", YAxis=Vector(0, 1, 0))
createtool = CreateTool(Name=tool_name, TCP=pl, Weight=weight, Mesh=mesh)  # -> Tool, TCP

# ----
list = RobotsLibrary(
    {"Franka Emika Panda", "Bartlett-IRB120", "Bartlett-IRB1600", "Bartlett-KR6", "Bartlett-KR60-A", "Bartlett-KR60-B", "Bartlett-KR500", "Bartlett-KR60 on track", "Bartlett-UR10", "Bartlett-KR60", "Bartlett-TX200", "Bartlett-TX200L", "Bartlett-RX160", "Bartlett-RX160L"}, selected="Bartlett-KR60",
    Type=0)

# ---- group: calibrated plane
pt_2 = Point(_3_point_base_calibration)
item = ListItem(List=pt_2, Index=0, Wrap=True)  # -> Item, Item1, Item2
pl_3pt = Plane3Pt(PointA=item.Item1, PointB=item.Item2, PointC=item.Item)

# ---- group: shape
srf = Surface(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)

# ---- group: create contours
mesh_uv = MeshSurface(Surface=srf, UCount="200", VCount="200", Overhang=True, Equalize=False)
contour = Contour(Shape=mesh_uv, Point=Point(0, 0, 0), Direction="0,0,-1", Distance="1")
split_2 = SplitTree(Data=contour, Masks="{0;0}")  # -> Positive, Negative
crv = Curve(flatten(split_2.Negative))
crv_2 = Curve(srf)
ins = InsertItems(List=crv, Item=crv_2, Indices="0", Wrap=True)

# ---- group: robot
loadrobotsystem = LoadRobotSystem(Name=list, Base=PlaneXY(0, 0, 0))

# ---- group: create spiral
crv_cp = CurveClosestPoint(Point="0,0,0", Curve=ins)  # -> Point, Parameter, Distance
seam = Seam(Curve=ins, Seam=crv_cp.Parameter)
panel = Panel("""-1
0""")
cull_i = CullIndex(List=seam, Indices=graft(panel), Wrap=True)
flip = FlipMatrix(Data=cull_i)
divide = DivideCurve(Curve=flip, Count="200", Kinks=False)  # -> Points, Tangents, Parameters
item_2 = ListItem(List=divide.Points, Index=0, Wrap=True)
ins_2 = InsertItems(List=divide.Points, Item=item_2, Indices="-1", Wrap=True)
split_3 = SplitTree(Data=ins_2, Masks="{*;0;0}")  # -> Positive, Negative
range = Range(Domain=Domain(0, 1), Steps="200")
expression = Expression(x=split_3.Positive, y=split_3.Negative, t=range, Expression="x*(1-t)+y*t")  # -> flatten(R)
pline = PolyLine(Vertices=expression, Closed=False)

# ---- group: create target locations
topoly = CurveToPolyline(Curve=pline, ToleranceDistance="0.1", ToleranceAngle=0)  # -> Polyline, Segments
cp = ControlPoints(Curve=topoly.Polyline)  # -> Points, Weights, Knots
pl_2 = ConstructPlane(Origin=cp.Points, XAxis="-1,0,0", YAxis=Vector(0, 1, 0))

# ---- group: create forming targets
list_2 = ValueList({"Joint", "Linear"}, selected="Linear")
panel_2 = Panel("35")
panel_3 = Panel("3.5")
panel_4 = Panel("0,0")

# ----
pln_2 = Plane(pl_3pt)
createtarget = CreateTarget(
    Plane=pl_2,
    Motion=list_2,
    Tool=createtool.Tool,
    Speed=panel_2,
    Zone=panel_3,
    Frame=pln_2,
    External=panel_4,
    IsCartesian=True)
xy = XYPlane(Origin=Point(0, 0, 0))
panel_5 = Panel("""0
-1""")

# ---- group: home position
panel_6 = Panel("0,pi/2,0,0,0,0")

# ----
panel_7 = Panel("""0
-1""")

# ---- group: create program
panel_8 = Panel("MetalForming")
panel_9 = Panel("10")

# ---- group: approach targets
panel_10 = Panel("""0
-1""")
approach_distance = Panel("100")
item_3 = ListItem(List=createtarget, Index=panel_10, Wrap=True)
pl_offset = PlaneOffset(BasePlane=xy, Offset=approach_distance)
approach_speed = Panel("250")
item_4 = ListItem(List=createtarget, Index=0, Wrap=True)
list_3 = ValueList({"Joint", "Linear"}, selected="Joint")
speed = SpeedParameter(approach_speed)

# ----
deconstructtarget = DeconstructTarget(Target=item_3)

# ---- group: approach targets (continued)
project = Project(Geometry=deconstructtarget, Plane=pl_offset)  # -> Geometry, Transform
item_5 = ListItem(List=project.Geometry, Index=0, Wrap=True)  # -> Item, Item1

# ----
createtarget_2 = CreateTarget(Target=item_4, Plane=item_5.Item, Motion=list_3, Speed=speed, IsCartesian=True)
createtarget_3 = CreateTarget(Target=item_4, Plane=item_5.Item1, Speed=speed, IsCartesian=True)

# ---- group: approach targets (continued)
merge = Merge(Data1=createtarget_2, Data2=createtarget_3)

# ----
ins_3 = InsertItems(List=createtarget, Item=merge, Indices=panel_5, Wrap=True)
createtarget_4 = CreateTarget(Target=createtarget_2, Joints=panel_6, IsCartesian=False)
ins_4 = InsertItems(List=ins_3, Item=createtarget_4, Indices=panel_7, Wrap=True)
createprogram = CreateProgram(Name=panel_8, RobotSystem=loadrobotsystem, Targets=ins_4, StepSize=panel_9)  # -> Program, Code, Duration, Warnings, Errors

# ---- group: preview tool path
time = Slider(0, range=0..1)
programsimulation = ProgramSimulation(Program=createprogram.Program, Time=time, Normalized=True)  # -> SystemMeshes, JointRotations, Plane, Index, Time, Program, Errors

# ---- group: save program to file
saveprogram = SaveProgram(Program=createprogram.Program, Folder="C:\FolderPath")  # disabled

# ----
c_script = CSharpScript(P=programsimulation.Program)  # -> out, A
# ---------- c_script: C# ----------
#r "Robots.dll"

using System.Collections.Generic;

using Rhino.Geometry;

using Grasshopper.Kernel;
using Robots;

public class Script_Instance : GH_ScriptInstance
{
    private void RunScript(object P, ref object A)
    {
        var program = P as Robots.Program;

        if (program is null || !program.HasSimulation)
            return;

        int group = 0;
        int currentIndex = program.CurrentSimulationPose.TargetIndex;
        var currentTarget = program.Targets[currentIndex];
        var points = new List<Point3d>();

        foreach (var cellTarget in program.Targets)
        {
            var target = cellTarget.ProgramTargets[group];

            if (target.IsJointMotion)
                continue;

            if (target.Index <= currentIndex)
            {
                points.Add(target.Plane.Origin);
            }
            else
            {
                var plane = currentIndex > 0 && !program.Targets[currentIndex - 1].ProgramTargets[group].IsJointMotion
                    ? currentTarget.ProgramTargets[group].Plane
                    : Plane.WorldXY;
                points.Add(plane.ClosestPoint(target.Plane.Origin));
            }
        }

        if (points.Count > 0)
            points.RemoveAt(points.Count - 1);

        A = points;
    }
}
# ---------- end c_script ----------

# ---- group: metal forming visualization
panel_11 = Panel("""0
100
500
600""")
crossref = CrossReference(ListA=panel_11, ListB=panel_11, CrossMode=1)  # -> ListA, ListB
pt_3 = PointOriented(BasePlane=PlaneXY(0, 0, 0), UComponent=crossref.ListA, VComponent=crossref.ListB, WComponent=0)
pt_4 = Point(flatten([pt_3, cp.Points]))
pt_5 = Point(flatten([pt_3, c_script.A]))
del = DelaunayMesh(Points=pt_4, Plane=PlaneXY(0, 0, 0))
demesh = DeconstructMesh(Mesh=del)  # -> Vertices, Faces, Colours, Normals
conmesh = ConstructMesh(Vertices=pt_5, Faces=demesh.Faces)
pln_3 = Plane(pl_3pt)
orient = Orient(Geometry=conmesh, Source=PlaneXY(0, 0, 0), Target=pln_3)  # -> Geometry, Transform

# ----
split_4 = SplitList(List=programsimulation.SystemMeshes, Index="10")  # -> ListA, ListB

# ---- group: display geometry
preview = CustomPreview(Geometry=split_4.ListA, Shader=ColourSwatch(SwatchColor=RGB(199, 94, 24)))
preview_2 = CustomPreview(Geometry=split_4.ListB, Shader=ColourSwatch(SwatchColor=RGB(104, 115, 115)))
preview_3 = CustomPreview(Geometry=orient.Geometry, Shader=ColourSwatch(SwatchColor=RGB(107, 104, 104)))
