# Grasshopper definition positioner example.gh (Grasshopper 1.0.7)
# plug-ins: Robots

# Toolpath should be placed at the origin
crv = Curve([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])
mesh = Mesh(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)
mesh_2 = Mesh(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)
crv_2 = Curve(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)
# WARNING: This is an incomplete example, do not use in production.
# 
# It is missing approaches, retractions, and other elements of a complete milling toolpath.
list = RobotsLibrary(
    {"Bartlett-IRB120", "Bartlett-IRB1600", "Bartlett-KR6", "Bartlett-KR60-A", "Bartlett-KR60-B", "Bartlett-KR500", "Bartlett-KR60 on track", "Bartlett-UR10", "Bartlett-KR60", "Bartlett-TX200", "Bartlett-TX200L", "Bartlett-RX160", "Bartlett-RX160L", "Nagami Multimove", "Nagami IRB6700", "Nagami IRB4600", "Nagami IRB6640", "TTDA-KR6", "TTDA-KR60", "TTDA-IIWA14", "Penn-IRB120", "Penn-IRB4600-60", "Penn-IRB4600-60 + Track", "uem-IRB120", "uem-IRB1600", "uem-IRB2600", "uem-IRB1600_IRB2600"}, selected="Bartlett-KR60",
    Type=0)
cp = ControlPoints(Curve=crv)  # -> flatten(Points), Weights, Knots
end = EndPoints(Curve=crv_2)  # -> Start, End
pl = PlaneNormal(Origin=end.Start, ZAxis=crv_2)
project = Project(Geometry=cp.Points, Plane=PlaneXY(0, 0, 0))  # -> Geometry, Transform
loadrobot = LoadRobotSystem(Name=list, Base=PlaneXY(0, 0, 0))
tool = CreateTool(Name="Spindle", TCP=pl, Weight="15", Mesh=mesh_2)  # -> Tool, TCP
rev = Reverse(Vector=project.Geometry)
# Caculate a joint value per target for the positioner. In this example, the spindle is aligned to a fixed vector
xy = XYPlane(Origin=Point(0, 0, 0))
pl_2 = PlaneNormal(Origin=cp.Points, ZAxis=rev)
angle = Angle(VectorA=rev, VectorB="1,0.2,0", Plane=xy)  # -> Angle, Reflex
# This frame sets the positioner as origin. Moving the positioner will move the origin with it
panel = Panel("0")
align = AlignPlane(Plane=pl_2, Direction="0,0,1")  # -> Plane, Angle
frame = CreateFrame(Plane=PlaneXY(0, 0, 0), CoupledMechanicalGroup=panel, CoupledMechanism=panel)
concat = Concatenate(FragmentA="0,", FragmentB=angle.Angle)
target = CreateTarget(Joints="0,pi*0.6,0,0,-0.35*pi,-pi", Tool=tool.Tool, Zone="10", External="0", IsCartesian=False)
panel_2 = Panel("""Joint
Linear""")
target_2 = CreateTarget(Target=target, Plane=align.Plane, Motion=panel_2, Speed="200", Frame=frame, External=concat, IsCartesian=True)
merge = Merge(Data1=target, Data2=target_2)
program = CreateProgram(Name="Positioner", RobotSystem=loadrobot, Targets=merge, StepSize=1)  # -> Program, Code, Duration, Warnings, Errors
sim = ProgramSimulation(Program=program.Program, Time=Slider(0, range=0..1), Normalized=True)  # -> SystemMeshes, JointRotations, Plane, Index, Time, Program, Errors
item = ListItem(List=sim.Plane, Index="2", Wrap=True)
# Orient the model using the positioner plane to better visualize the toolpath
orient = Orient(Geometry=mesh, Source=PlaneXY(0, 0, 0), Target=item)  # -> Geometry, Transform
