# Grasshopper definition positioner-example.gh (Grasshopper 1.0.8)
# plug-ins: Robots

# Toolpath should be placed at the origin
crv = Curve([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])
mesh = Mesh(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)
crv_2 = Curve(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)
mesh_2 = Mesh(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)
# WARNING: This is an incomplete example, do not use in production.
# 
# It is missing approaches, retractions, and other elements of a complete milling toolpath.
list = RobotsLibrary(
    {"Franka Emika Panda", "Bartlett-IRB120", "Bartlett-IRB1600", "Bartlett-KR6", "Bartlett-KR60-A", "Bartlett-KR60-B", "Bartlett-KR500", "Bartlett-KR60 on track", "Bartlett-UR10", "Bartlett-KR60", "Bartlett-TX200", "Bartlett-TX200L", "Bartlett-RX160", "Bartlett-RX160L"}, selected="Bartlett-KR60",
    Type=0)
cp = ControlPoints(Curve=crv)  # -> flatten(Points), Weights, Knots
end = EndPoints(Curve=crv_2)  # -> Start, End
pl = PlaneNormal(Origin=end.Start, ZAxis=crv_2)
project = Project(Geometry=cp.Points, Plane=PlaneXY(0, 0, 0))  # -> Geometry, Transform
loadrobotsystem = LoadRobotSystem(Name=list, Base=PlaneXY(0, 0, 0))
createtool = CreateTool(Name="Spindle", TCP=pl, Weight="15", Mesh=mesh_2)  # -> Tool, TCP
rev = Reverse(Vector=project.Geometry)
# Caculate a joint value per target for the positioner. In this example, the spindle is aligned to a fixed vector
xy = XYPlane(Origin=Point(0, 0, 0))
pl_2 = PlaneNormal(Origin=cp.Points, ZAxis=rev)
angle = Angle(VectorA=rev, VectorB="1,0.2,0", Plane=xy)  # -> Angle, Reflex
# This frame sets the positioner as origin. Moving the positioner will move the origin with it
panel = Panel("0")
align = AlignPlane(Plane=pl_2, Direction="0,0,1")  # -> Plane, Angle
createframe = CreateFrame(Plane=PlaneXY(0, 0, 0), CoupledMechanicalGroup=panel, CoupledMechanism=panel)
concat = Concatenate(FragmentA="0,", FragmentB=angle.Angle)
createtarget = CreateTarget(Joints="0,pi*0.6,0,0,-0.35*pi,-pi", Tool=createtool.Tool, Zone="10", External="0,0", IsCartesian=False)
panel_2 = Panel("""Joint
Linear""")
createtarget_2 = CreateTarget(
    Target=createtarget,
    Plane=align.Plane,
    Motion=panel_2,
    Speed="200",
    Frame=createframe,
    External=concat,
    IsCartesian=True)
merge = Merge(Data1=createtarget, Data2=createtarget_2)
createprogram = CreateProgram(Name="Positioner", RobotSystem=loadrobotsystem, Targets=merge, StepSize=1)  # -> Program, Code, Duration, Warnings, Errors
programsimulation = ProgramSimulation(Program=createprogram.Program, Time=Slider(0, range=0..1), Normalized=True)  # -> SystemMeshes, JointRotations, Plane, Index, Time, Program, Errors
item = ListItem(List=programsimulation.Plane, Index="2", Wrap=True)
# Orient the model using the positioner plane to better visualize the toolpath
orient = Orient(Geometry=mesh, Source=PlaneXY(0, 0, 0), Target=item)  # -> Geometry, Transform
