# Grasshopper definition python-script-example.gh (Grasshopper 1.0.8)
# plug-ins: Robots

list = RobotsLibrary(
    {"Franka Emika Panda", "Bartlett-IRB120", "Bartlett-IRB1600", "Bartlett-KR6", "Bartlett-KR60-A", "Bartlett-KR60-B", "Bartlett-KR500", "Bartlett-KR60 on track", "Bartlett-UR10", "Bartlett-KR60", "Bartlett-TX200", "Bartlett-TX200L", "Bartlett-RX160", "Bartlett-RX160L"}, selected="Bartlett-IRB120",
    Type=0)
loadrobotsystem = LoadRobotSystem(Name=list, Base=PlaneXY(0, 0, 0))
python = Python3Script(R=loadrobotsystem)  # -> P, W
# ---------- python: Python ----------
from Rhino.Geometry import Point3d, Plane
from Robots import *

plane_a = Plane.WorldYZ
plane_b = Plane.WorldYZ
plane_a.Origin = Point3d(300, 200, 610)
plane_b.Origin = Point3d(300, -200, 610)

toolpath = SimpleToolpath([
    CartesianTarget(plane_a, RobotConfigurations.Wrist, Motions.Joint),
    CartesianTarget(plane_b, None, Motions.Linear, speed = Speed(300)),
])

P = Program("TestProgram", R, [toolpath])
W = P.Warnings
# ---------- end python ----------
program_warnings = Panel(python.W)
programsimulation = ProgramSimulation(Program=python.P, Time=Slider(0, range=0..1), Normalized=True)  # -> SystemMeshes, JointRotations, Plane, Index, Time, Program, Errors
