# Grasshopper definition simple-example.gh (Grasshopper 1.0.8)
# plug-ins: Robots

# ---- group: tool or end effector
# orientation relative to flange
# (use world origin as flange)
# no spaces
# tool center point (tcp)
# tool geometry
# (must be a single mesh)
tool_name = Panel("extruder")
pt = Point(Point(137.8363948, 2.467293384e-06, 44.59797803))
weight = Panel("2.0")
mesh = Mesh(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)
pl = ConstructPlane(Origin=pt, XAxis="0,0,-1", YAxis=Vector(0, 1, 0))
createtool = CreateTool(Name=tool_name, TCP=pl, Weight=weight, Mesh=mesh)  # -> Tool, TCP

# ----
# tool path
crv = Curve(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)

list = RobotsLibrary(
    {"Franka Emika Panda", "Bartlett-IRB120", "Bartlett-IRB1600", "Bartlett-KR6", "Bartlett-KR60-A", "Bartlett-KR60-B", "Bartlett-KR500", "Bartlett-KR60 on track", "Bartlett-UR10", "Bartlett-KR60", "Bartlett-TX200", "Bartlett-TX200L", "Bartlett-RX160", "Bartlett-RX160L"}, selected="Bartlett-IRB120",
    Type=0)

# ---- group: target position
# converts the curve into
# many straight segments
resolution = Panel("2.0")
topoly = CurveToPolyline(Curve=crv, ToleranceDistance=resolution, ToleranceAngle=0)  # -> Polyline, Segments
cp = ControlPoints(Curve=topoly.Polyline)  # -> Points, Weights, Knots

# ---- group: robot
# list of models included in library
# more can be added manually
loadrobotsystem = LoadRobotSystem(Name=list, Base=PlaneXY(0, 0, 0))

# ---- group: target orientation
# aligns the extruder to look down and
# away from the base of the robot
panel = Panel("-1,0,0")
pl_2 = ConstructPlane(Origin=cp.Points, XAxis=panel, YAxis=Vector(0, 1, 0))

# ---- group: create targets
# right click on the create target
# component to add aditional inputs
approximation_zone = Panel("2.0")
cut_speed = Panel("100.0")
list_2 = ValueList({"Joint", "Linear"}, selected="Linear")

# ----
createtarget = CreateTarget(Plane=pl_2, Motion=list_2, Tool=createtool.Tool, Speed=cut_speed, Zone=approximation_zone, IsCartesian=True)

# ---- group: create program
program_name = Panel("simpleExtrusion")

# ---- group: turn on and off the tool
# Adds commands to the first and last target that turn on
# and off the first digital output. Zone is set to 0 (stop point)
# to sync the commands with the position of the robot.
do_num = Panel("0")
approach_speed = Panel("250.0")
setdo = SetDO(DO=do_num, Value="0")
setdo_2 = SetDO(DO=do_num, Value="1")
stop_zone = Panel("0")
item = ListItem(List=createtarget, Index=0, Wrap=True)  # -> Item1, Item
speed = SpeedParameter(approach_speed)
zone = ZoneParameter(stop_zone)
panel_2 = Panel("""0
-2""")

# ----
createtarget_2 = CreateTarget(Target=item.Item, Speed=speed, Zone=zone, Command=setdo_2, IsCartesian=True)
createtarget_3 = CreateTarget(Target=item.Item1, Zone=zone, Command=setdo, IsCartesian=True)

# ---- group: turn on and off the tool (continued)
merge = Merge(Data1=createtarget_2, Data2=createtarget_3)
replace = ReplaceItems(List=createtarget, Item=merge, Indices=panel_2, Wrap=True)

# ----
# A home position should be set
# using joint rotation values. This is
# the only way to unambiguously
# define a robot pose.
home_position = Panel("0,pi*1.5/4,0,0,pi*0.5/4,0")
panel_3 = Panel("""0
-1""")

createtarget_4 = CreateTarget(Joints=home_position, Tool=createtool.Tool, Speed=speed, Zone="20", IsCartesian=False)

ins = InsertItems(List=replace, Item=createtarget_4, Indices=panel_3, Wrap=True)

createprogram = CreateProgram(Name=program_name, RobotSystem=loadrobotsystem, Targets=ins, StepSize=1)  # -> Program, Code, Duration, Warnings, Errors

# ---- group: preview
# Right click and select 'open controls' to
# preview the tool path, or move the slider.
number_slider = Slider(0, range=0..1)
programsimulation = ProgramSimulation(Program=createprogram.Program, Time=number_slider, Normalized=True)  # -> SystemMeshes, JointRotations, Plane, Index, Time, Program, Errors
time = Panel(programsimulation.Time)
simpletrail = SimpleTrail(Program=programsimulation.Program, Length=500, MechanicalGroup=0)

# ---- group: save program to file
# Enable this component to save
#  the program to a file.
panel_4 = Panel("C:\Folder")  # disabled
saveprogram = SaveProgram(Program=createprogram.Program, Folder=panel_4)  # disabled

# ----
robot_program = Panel(createprogram.Code)
