# Grasshopper definition pick and place example.gh (Grasshopper 1.0.7)
# plug-ins: Robots

list = RobotsLibrary(
    {"AR3", "DOF", "FnacRobot", "Staedtler-IRB1200", "Staubli TX60", "AA-KR60", "AA-KR30", "AA-KR60_KR30", "Bartlett-IRB120", "Bartlett-IRB1600", "Bartlett-KR6", "Bartlett-KR60-A", "Bartlett-KR60-B", "Bartlett-KR500", "Bartlett-KR60 on track", "Bartlett-UR10", "Bartlett-KR60", "Bartlett-TX200", "Bartlett-TX200L", "Bartlett-RX160", "Bartlett-RX160L"}, selected="Bartlett-IRB1600",
    Type=0)
speeds = Panel("""7000,pi*2
2000,pi*2
350,pi""")
zones = Panel("""50
2
0""")
wait_time = Panel("0.6")
gripper_close_time = Panel("0.4")

# ---- group: block
vertical_margin = Panel("12")
drop_distance = Panel("0,0,1")
block_size = Panel("""162
44
94""")

# ----
robot_height = Panel("0,0,550")

# ---- group: tool
grip_margin = Panel("20")

# ---- group: block planes
pln = Plane(Tree({0;0}: [Plane(origin=(369.6564187, -909.3483753, 94), x=(0.6802230862, -0.7330051521, 0), y=(-0.7330051521, -0.6802230862, 0)), Plane(origin=(331.6056393, -988.361633, 94), x=(0.4810853403, -0.8766737679, 0), y=(-0.8766737679, -0.4810853403, 0)), Plane(origin=(208.361633, -1111.605639, 94), x=(0.0226062297, -0.9997444465, 0), y=(-0.9997444465, -0.0226062297, 0)), Plane(origin=(-208.361633, -1111.605639, 94), x=(-0.8909301467, -0.4541403678, 0), y=(-0.4541403678, 0.8909301467, 0)), Plane(origin=(-331.6056393, -988.361633, 94), x=(-0.9985908785, -0.05306842202, 0), y=(-0.05306842202, 0.9985908785, 0)), Plane(origin=(129.3483753, -1149.656419, 94), x=(-0.2089502376, -0.9779262744, 0), y=(-0.9779262744, 0.2089502376, 0))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], {0;1}: [Plane(origin=(-369.6564187, 909.3483753, 94), x=(-0.6802230862, 0.7330051521, 0), y=(0.7330051521, 0.6802230862, 0)), Plane(origin=(-331.6056393, 988.361633, 94), x=(-0.4810853403, 0.8766737679, 0), y=(0.8766737679, 0.4810853403, 0)), Plane(origin=(-208.361633, 1111.605639, 94), x=(-0.0226062297, 0.9997444465, 0), y=(0.9997444465, 0.0226062297, 0)), Plane(origin=(208.361633, 1111.605639, 94), x=(0.8909301467, 0.4541403678, 0), y=(0.4541403678, -0.8909301467, 0)), Plane(origin=(331.6056393, 988.361633, 94), x=(0.9985908785, 0.05306842202, 0), y=(0.05306842202, -0.9985908785, 0)), Plane(origin=(-129.3483753, 1149.656419, 94), x=(0.2089502376, 0.9779262744, 0), y=(0.9779262744, -0.2089502376, 0))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]))

# ---- group: calibrated support planes
pln_2 = Plane([PlaneXY(0, -1030.517293, 0), PlaneXY(0, 1030.517293, 0)])

# ---- group: tool / dynamic tool
brep = Brep([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])

# ---- group: tool / static tool
brep_2 = Brep([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])

# ---- group: tool / tcp
crv = Curve(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)

# ----
speed = SpeedParameter(speeds)
zone = ZoneParameter(zones)
item = ListItem(List=block_size, Index=0, Wrap=True)  # -> Item, Item1, Item2
panel = Panel(list)
load_robot = LoadRobotSystem(Name=list, Base=robot_height)

# ---- group: create block
item_2 = ListItem(List=block_size, Index=0, Wrap=True)  # -> Item, Item1, Item2
dom = ConstructDomain(DomainStart=expr("-x/2", item_2.Item), DomainEnd=expr("x/2", item_2.Item))
dom_2 = ConstructDomain(DomainStart=expr("-x/2", item_2.Item1), DomainEnd=expr("x/2", item_2.Item1))
box = DomainBox(Base=PlaneXY(0, 0, 0), X=dom, Y=dom_2, Z=item_2.Item2)
mesh = Mesh(box)

# ---- group: create supports
project = Project(Geometry=pln, Plane=PlaneXY(0, 0, 0))  # -> Geometry, Transform
bbox = BoundingBox(Content=project.Geometry, Plane=PlaneXY(0, 0, 0), UnionBox=True)  # -> flatten(Box), Box_2
rec = Rectangle(bbox.Box)
offset_l = OffsetLoose(Curve=rec, Distance="50")

# ----
rec_2 = Rectangle(offset_l)
pln_3 = Plane(rec_2)
pln_4 = Plane(pln_2)
expression = Expression(x=item.Item2, y=vertical_margin, Expression="-(x+y*2)")
pt = Point(robot_height)

# ---- group: target attributes indices
pick = Panel("""0,0,0,0
0,0,0,1
0,0,0,1
1,0,2,2
1,1,2,1
0,1,0,1
0,1,0,0""")
place = Panel("""0,1,0,0
0,1,0,1
0,1,1,1
1,1,2,2
1,0,2,1
0,0,0,1
0,0,0,0""")

# ----
split = TextSplit(Text=[pick, place], Separators=",")
flip = FlipMatrix(Data=split)
program_name = Panel("PickAndPlace")
panel_2 = Panel("""0
-1""")
rec_3 = Rectangle(rec_2)
pln_5 = Plane(pln_4)
num = Number(robot_height)
# * speed limit reached *
panel_3 = Panel("Configuration changed *")

# ---- group: create environment
cluster = Cluster(rec=rec_3, P=pln_5, L=num)

# ---- group: create tool
addition = Addition(A=grip_margin, B=item.Item1)
line = Line(crv)
merge = Merge(Data1=addition, Data2=item.Item1)
len = Length(Curve=line)
expression_2 = Expression(x=len, y=merge, Expression="(x-y)/2")
panel_4 = Panel("""1
-1""")
mesh_2 = MeshBrep(
    Brep=brep_2,
    Settings={GridMaxCount=0, GridMinCount=16, JaggedSeams=False, MaxEdgeLength=0, MinEdgeLength=0.0001, MinTolerance=0, Refine=True, RefineAngle=0, RelativeTolerance=0.65, SimplePlanes=True, Tolerance=0})
mesh_3 = MeshBrep(
    Brep=brep,
    Settings={GridMaxCount=0, GridMinCount=16, JaggedSeams=False, MaxEdgeLength=0, MinEdgeLength=0.0001, MinTolerance=0, Refine=True, RefineAngle=0, RelativeTolerance=0.65, SimplePlanes=True, Tolerance=0})
eval = EvaluateLength(Curve=line, Length=0.5, Normalized=True)  # -> Point, Tangent, Parameter
xy = XYPlane(Origin=eval.Point)
pl = ConstructPlane(Origin=xy, XAxis="0,0,-1", YAxis=Vector(0, 1, 0))
panel_5 = Panel("""GripperUnloaded
GripperLoaded""")
tool_weight = Panel("""5.0
6.5""")

# ----
multiplication = Multiplication(A=graft(expression_2), B=panel_4)

# ---- group: create tool (continued)
amp = Amplitude(Vector=line, Amplitude=multiplication)
move = Move(Geometry=mesh_3, Motion=amp)  # -> Geometry, Transform
ins = InsertItems(List=move.Geometry, Item=mesh_2, Indices="0", Wrap=True)
mjoin = MeshJoin(Meshes=ins)  # -> flatten(Mesh)
tool = CreateTool(Name=panel_5, TCP=pl, Weight=tool_weight, Mesh=mjoin)  # -> Tool, TCP

# ---- group: target attributes
panel_6 = Panel("""Joint
Linear""")
entwine = Entwine(Branch00=panel_6, Branch01=tool.Tool, Branch02=speed, Branch03=zone, FlattenInputs=True)

# ----
item_3 = ListItem(List=entwine, Index=flip, Wrap=True)
flip_2 = FlipMatrix(Data=item_3)
item_4 = ListItem(List=flip_2, Index=0, Wrap=True)  # -> Item, Item1, Item2, Item3

# ---- group: home position
item_5 = ListItem(List=tool.Tool, Index=0, Wrap=True)
item_6 = ListItem(List="0,pi/2,pi/4,0,-pi/4,0", Index=0, Wrap=True)
target = CreateTarget(Joints=item_6, Tool=item_5, Speed="250", Zone="5", IsCartesian=False)

# ---- group: align gripper
panel_7 = Panel("""0
pi""")
prot = RotatePlane(Plane=graft(pln), Angle=panel_7)
deplane = DeconstructPlane(Plane=prot)  # -> Origin, XAxis, YAxis, ZAxis

# ----
rev = Reverse(Vector=deplane.XAxis)
project_2 = Project(Geometry=deplane.Origin, Plane=PlaneXY(0, 0, 0))  # -> Geometry, Transform

# ---- group: align gripper (continued)
angle = Angle(VectorA=project_2.Geometry, VectorB=rev)  # -> Angle, Reflex
sort = SortList(Keys=angle.Angle, ValuesA=prot)  # -> Keys, ValuesA
item_7 = ListItem(List=sort.ValuesA, Index=0, Wrap=True)
trim = TrimTree(Tree=item_7, Depth=1)

# ---- group: orient blocks to supports
orient = Orient(Geometry=trim, Source=graft(pln_3), Target=graft(pln_4))  # -> Geometry, Transform

# ----
move_2 = Move(Geometry=orient.Geometry, Motion=drop_distance)  # -> Geometry, Transform
split_2 = SplitTree(Data=move_2.Geometry, Masks="{0;0}")  # -> Positive, Negative
pln_6 = Plane(reverse(split_2.Positive))
pln_7 = Plane(split_2.Negative)
pl_offset = PlaneOffset(BasePlane=pln_6, Offset=expression)
pl_offset_2 = PlaneOffset(BasePlane=pln_7, Offset=expression)
pln_8 = Plane(pl_offset)
pln_9 = Plane(pl_offset_2)
entwine_2 = Entwine(Branch00=pln_8, Branch01=pln_9, FlattenInputs=True)
flip_3 = FlipMatrix(Data=entwine_2)
pdecon = Deconstruct(Point=flip_3)  # -> XComponent, YComponent, ZComponent
sort_2 = SortList(Keys=pdecon.ZComponent)  # -> Keys, ValuesA
cull_i = CullIndex(List=pl_offset_2, Indices="-1", Wrap=True)
item_8 = ListItem(List=sort_2.Keys, Index="-1", Wrap=True)
cull_i_2 = CullIndex(List=pl_offset, Indices="0", Wrap=True)
pdecon_2 = Deconstruct(Point=pl_offset)  # -> XComponent, YComponent, ZComponent
pdecon_3 = Deconstruct(Point=cull_i)  # -> XComponent, YComponent, ZComponent
pt_2 = ConstructPoint(XCoordinate=pdecon.XComponent, YCoordinate=pdecon.YComponent, ZCoordinate=item_8)
pdecon_4 = Deconstruct(Point=pl_offset_2)  # -> XComponent, YComponent, ZComponent
pdecon_5 = Deconstruct(Point=cull_i_2)  # -> XComponent, YComponent, ZComponent
max = Maximum(A=pdecon_2.ZComponent, B=pdecon_3.ZComponent)
pl_origin = PlaneOrigin(Base=flip_3, Origin=pt_2)
max_2 = Maximum(A=pdecon_4.ZComponent, B=pdecon_5.ZComponent)
pt_3 = ConstructPoint(XCoordinate=pdecon_2.XComponent, YCoordinate=pdecon_2.YComponent, ZCoordinate=max)
pln_10 = Plane(pl_offset)
pln_11 = Plane(pl_offset_2)
item_9 = ListItem(List=pl_origin, Index=0, Wrap=True)  # -> flatten(Item), flatten(Item1)
pt_4 = ConstructPoint(XCoordinate=pdecon_4.XComponent, YCoordinate=pdecon_4.YComponent, ZCoordinate=max_2)
pt_5 = Point(pln_10)
pt_6 = Point(pln_11)
rev_2 = Reverse(Vector=pt_5)
rev_3 = Reverse(Vector=pt_6)
align = AlignPlane(Plane=pln_10, Direction=rev_2)  # -> Plane, Angle
align_2 = AlignPlane(Plane=pln_11, Direction=rev_3)  # -> Plane, Angle
pl_origin_2 = PlaneOrigin(Base=align.Plane, Origin=item_9.Item)
pl_origin_3 = PlaneOrigin(Base=align_2.Plane, Origin=item_9.Item1)
pl_origin_4 = PlaneOrigin(Base=align_2.Plane, Origin=pt_4)
pl_origin_5 = PlaneOrigin(Base=align.Plane, Origin=pt_3)
pln_12 = Plane(pl_origin_4)
pln_13 = Plane(pl_origin_5)
pln_14 = Plane(pl_origin_2)
pln_15 = Plane(pl_origin_3)
deplane_2 = DeconstructPlane(Plane=pln_13)  # -> Origin, XAxis, YAxis, ZAxis
deplane_3 = DeconstructPlane(Plane=pln_14)  # -> Origin, XAxis, YAxis, ZAxis
deplane_4 = DeconstructPlane(Plane=pln_15)  # -> Origin, XAxis, YAxis, ZAxis
deplane_5 = DeconstructPlane(Plane=pln_12)  # -> Origin, XAxis, YAxis, ZAxis
vec2pt = Vector2Pt(PointA=deplane_2.Origin, PointB=pt, Unitize=False)  # -> Vector, Length
rev_4 = Reverse(Vector=deplane_2.YAxis)
vec2pt_2 = Vector2Pt(PointA=deplane_3.Origin, PointB=pt, Unitize=False)  # -> Vector, Length
rev_5 = Reverse(Vector=deplane_3.YAxis)
vec2pt_3 = Vector2Pt(PointA=deplane_4.Origin, PointB=pt, Unitize=False)  # -> Vector, Length
rev_6 = Reverse(Vector=deplane_4.YAxis)
vec2pt_4 = Vector2Pt(PointA=deplane_5.Origin, PointB=pt, Unitize=False)  # -> Vector, Length
rev_7 = Reverse(Vector=deplane_5.YAxis)
angle_2 = Angle(VectorA=vec2pt.Vector, VectorB=deplane_2.XAxis)  # -> Angle, Reflex
angle_3 = Angle(VectorA=vec2pt_2.Vector, VectorB=deplane_3.XAxis)  # -> Angle, Reflex
angle_4 = Angle(VectorA=vec2pt_3.Vector, VectorB=deplane_4.XAxis)  # -> Angle, Reflex
angle_5 = Angle(VectorA=vec2pt_4.Vector, VectorB=deplane_5.XAxis)  # -> Angle, Reflex
rot3d = Rotate3D(Geometry=pln_13, Angle=angle_2.Angle, Center=deplane_2.Origin, Axis=rev_4)  # -> Geometry, Transform
rot3d_2 = Rotate3D(Geometry=pln_14, Angle=angle_3.Angle, Center=deplane_3.Origin, Axis=rev_5)  # -> Geometry, Transform
rot3d_3 = Rotate3D(Geometry=pln_15, Angle=angle_4.Angle, Center=deplane_4.Origin, Axis=rev_6)  # -> Geometry, Transform
rot3d_4 = Rotate3D(Geometry=pln_12, Angle=angle_5.Angle, Center=deplane_5.Origin, Axis=rev_7)  # -> Geometry, Transform

# ---- group: pick targets
pln_16 = Plane(rot3d.Geometry)
pln_17 = Plane(align.Plane)
pln_18 = Plane(pl_offset)
pln_19 = Plane(pln_6)
pln_20 = Plane(rot3d_2.Geometry)

# ---- group: place targets
pln_21 = Plane(align_2.Plane)
pln_22 = Plane(pln_7)
pln_23 = Plane(rot3d_3.Geometry)
pln_24 = Plane(pl_offset_2)
pln_25 = Plane(rot3d_4.Geometry)

# ----
entwine_3 = Entwine(
    Branch00=pln_16,
    Branch01=pln_17,
    Branch02=pln_18,
    Branch03=pln_19,
    Branch04=pln_18,
    Branch05=pln_17,
    Branch06=pln_20,
    Branch07=pln_23,
    Branch08=pln_21,
    Branch09=pln_24,
    Branch010=pln_22,
    Branch011=pln_24,
    Branch012=pln_21,
    Branch013=pln_25,
    FlattenInputs=True)
target_2 = CreateTarget(Plane=entwine_3, Motion=item_4.Item, Tool=item_4.Item1, Speed=item_4.Item2, Zone=item_4.Item3, IsCartesian=True)
flip_4 = FlipMatrix(Data=target_2)

# ---- group: unwind forearm by setting an unambiguous pose
target_3 = TargetParameter(flip_4)
panel_8 = Panel("""0
7""")
item_10 = ListItem(List=target_3, Index=panel_8, Wrap=True)
K = Kinematics(RobotSystem=load_robot, Target=graft(item_10), Geometry=False)  # -> MechanismMeshes, JointRotations, Plane, Errors
panel_9 = Panel("""0
4""")

# ----
trim_2 = TrimTree(Tree=K.JointRotations, Depth=1)

# ---- group: unwind forearm by setting an unambiguous pose (continued)
split_3 = TextSplit(Text=trim_2, Separators=",")
item_11 = ListItem(List=split_3, Index="3", Wrap=True)
trim_3 = TrimTree(Tree=item_11, Depth=1)
abs = Absolute(Value=trim_3)
larger = LargerThan(FirstNumber=abs, SecondNumber="pi/2")  # -> LargerThan, OrEqualTo
item_12 = ListItem(List=panel_9, Index=larger.LargerThan, Wrap=True)
target_4 = CreateTarget(Target=item_10, RobConf=item_12, IsCartesian=True)
K_2 = Kinematics(RobotSystem=load_robot, Target=graft(target_4), Geometry=False)  # -> MechanismMeshes, JointRotations, Plane, Errors

# ----
trim_4 = TrimTree(Tree=K_2.JointRotations, Depth=1)

# ---- group: unwind forearm by setting an unambiguous pose (continued)
target_5 = CreateTarget(Target=item_10, Joints=trim_4, IsCartesian=False)
replace = ReplaceItems(List=target_3, Item=target_5, Indices=panel_8, Wrap=False)

# ---- group: add commands for gripping
close_do = Panel("1")
open_do = Panel("0")
num_2 = Number(wait_time)
pulsedo = PulseDO(DO=close_do, Time=0.2)
wait = Wait(Time=num_2)
pulsedo_2 = PulseDO(DO=open_do, Time=0.2)
merge_2 = Merge(Data1=pulsedo_2, Data2=wait)
merge_3 = Merge(Data1=pulsedo, Data2=wait)
target_6 = TargetParameter(replace)
groupcmd = GroupCommand(Commands=merge_2)
panel_10 = Panel("""3
10""")
groupcmd_2 = GroupCommand(Commands=merge_3)
item_13 = ListItem(List=target_6, Index=panel_10, Wrap=True)
merge_4 = Merge(Data1=groupcmd_2, Data2=groupcmd)
target_7 = CreateTarget(Target=item_13, Command=merge_4, IsCartesian=True)
replace_2 = ReplaceItems(List=target_6, Item=target_7, Indices=panel_10, Wrap=False)

# ----
ins_2 = InsertItems(List=flatten(replace_2), Item=target, Indices=panel_2, Wrap=True)
program = CreateProgram(Name=program_name, RobotSystem=load_robot, Targets1=ins_2, InitCommands=pulsedo_2, StepSize="1")  # -> Program, Code, Duration, Warnings, Errors

# ---- group: collision detection between gripper and forearm
collisions = CheckCollisions(Program=program.Program, FirstSet=7, SecondSet=4, EnvironmentPlane=-1, LinearStepSize="100", AngularStepSize="pi/8")  # -> CollisionFound, TargetIndex, CollidedMeshes; disabled
panel_11 = Panel(collisions.TargetIndex)
panel_12 = Panel(collisions.CollisionFound)

# ---- group: tool path simulation
knob = ControlKnob(Decimals=6, Limit=True, Maximum=1, Minimum=0, Range=0.1, Value=1)
sim = ProgramSimulation(Program=program.Program, Time=knob, Normalized=True)  # -> RobotMeshes, JointRotations, Plane, Index, Time, Program, Errors

# ---- group: blocks visualization
c_script = CSharpScript(
    P=sim.Program,
    W=gripper_close_time,
    Bp=orient.Geometry,
    Reference="C:\source\visose\Robots\artifacts\bin\Robots.Grasshopper\net48\Robots.dll")  # -> out, T, G, Br; inputs W: Double, Bp: tree of Plane
# ---------- c_script: C# usings ----------
using System.IO;
using System.Linq;
using System.Data;
using System.Drawing;
using System.Reflection;
using System.Windows.Forms;
using System.Xml;
using System.Xml.Linq;
using System.Runtime.InteropServices;

using Rhino.DocObjects;
using Rhino.Collections;
using GH_IO;
using GH_IO.Serialization;
using Robots;
using Robots.Commands;
# ---------- c_script: C# ----------
    if(P == null)
      return;
    
    if(P as Program != program)
    {
      program = P as Program;
      Setup(Bp.Branch(0).Count);
    }

    var current = program.CurrentSimulationPose;
    double currentTime = current.CurrentTime;
    var currentIndex = current.TargetIndex;
    var currentTarget = program.Targets[currentIndex];
    var currentTool = currentTarget.ProgramTargets[group].Target.Tool;
    int i = Math.Min(currentIndex + 1, program.Targets.Count - 1);
    var nextTarget = program.Targets[i];
    var nextTool = nextTarget.ProgramTargets[group].Target.Tool;
    Plane plane = current.GetLastPlane(group);

    var mesh = currentTool.Mesh.DuplicateMesh();
    mesh.Vertices.Clear();
    var vertices = currentTool.Mesh.Vertices.Zip(nextTool.Mesh.Vertices, (x,y) => Lerp(x, y, currentTime, currentTarget.TotalTime - W, currentTarget.TotalTime));
    mesh.Vertices.AddVertices(vertices);
    mesh.Transform(Transform.PlaneToPlane(currentTool.Tcp, plane));
    T = mesh;

    if (currentTool.Name == "GripperLoaded")
      G = plane;

    var currentBlocks = new DataTree<Plane>();
    currentBlocks.AddRange(Bp.Branch(0).GetRange(0, blocksRemaining[currentTarget.Index]), new GH_Path(0));
    currentBlocks.AddRange(Bp.Branch(1).GetRange(0, blocksPlaced[currentTarget.Index]), new GH_Path(1));
    Br = currentBlocks;
# ---------- c_script: C# additional code ----------
  Program program;
  int group = 0;
  List<int> blocksRemaining;
  List<int> blocksPlaced;

  void Setup(int blockCount)
  {
    blocksRemaining = new List<int>();
    blocksPlaced = new List<int>();

    int remaining = blockCount;
    int placed = 0;

    foreach(var cellTarget in program.Targets)
    {
      var target = cellTarget.ProgramTargets[group];
      if (target.Index != 0)
      {
        var pulse = program.Targets[target.Index - 1].ProgramTargets[group].Commands.FirstOrDefault() as Robots.Commands.PulseDO;

        if (pulse != null)
        {
          if (pulse.DO == 1) remaining -= 1;
          if (pulse.DO == 0) placed += 1;
        }
      }
      blocksRemaining.Add(remaining);
      blocksPlaced.Add(placed);
    }
  }

  Point3d Lerp(Point3d a, Point3d b, double t, double min, double max)
  {
    t = (t - min) / (max - min);
    if (double.IsNaN(t)) t = 0;
    t = Rhino.RhinoMath.Clamp(t, 0, 1);
    var mid = a * (1 - t) + b * t;
    return mid;
  }
# ---------- end c_script ----------

# ----
orient_2 = Orient(Geometry=mesh, Source=PlaneXY(0, 0, 0), Target=[c_script.Br, c_script.G])  # -> Geometry, Transform
medges = MeshEdges(Mesh=orient_2.Geometry)  # -> NakedEdges, InteriorEdges, NonManifoldEdges
cull_i_3 = CullIndex(List=sim.RobotMeshes, Indices="-1", Wrap=True)
txt = Text(program.Warnings)

# ---- group: joint values over time
decprogtarg = DeconstructProgramTargets(Program=program.Program)  # -> Planes, Joints, Configuration, DeltaTime
flip_5 = FlipMatrix(Data=decprogtarg.Joints)
panel_13 = Panel("""0
1""")
ins_3 = InsertItems(List=flip_5, Item=panel_13, Indices="0", Wrap=True)

# ---- group: display geometry
preview = CustomPreview(Geometry=cluster, Shader=ColourSwatch(SwatchColor=RGB(38, 38, 38)))
preview_2 = CustomPreview(Geometry=medges.InteriorEdges, Shader=ColourSwatch(SwatchColor=RGB(38, 38, 38)))
preview_3 = CustomPreview(Geometry=cull_i_3, Shader=ColourSwatch(SwatchColor=RGB(212, 85, 0)))
preview_4 = CustomPreview(Geometry=c_script.T, Shader=ColourSwatch(SwatchColor=RGB(113, 114, 120)))
preview_5 = CustomPreview(Geometry=orient_2.Geometry, Shader=ColourSwatch(SwatchColor=RGB(94, 153, 49)))

# ----
tmatch = MatchText(Text=txt, Pattern=panel_3, Case=True)
cull = CullPattern(List=txt, CullPattern=tmatch)
graph = QuickGraph(ins_3, SortOrder=0)
warnings = Panel(cull)

# ==== cluster Cluster
rec = ClusterInput()
Z = UnitZ(Factor=1)
P = ClusterInput()
rec_2 = Rectangle(rec)
L = ClusterInput()
projecta = ProjectAlong(Geometry=rec_2, Plane=P, Direction=Z)  # -> Geometry, Transform
cyl = Cylinder(Base=PlaneXY(0, 0, 0), Radius="450", Length=L)
rulesrf = RuledSurface(CurveA=rec_2, CurveB=projecta.Geometry)
cap = CapHoles(Brep=flatten([rulesrf, cyl]))
mesh = MeshBrep(
    Brep=cap,
    Settings={GridMaxCount=0, GridMinCount=16, JaggedSeams=False, MaxEdgeLength=0, MinEdgeLength=0.0001, MinTolerance=0, Refine=True, RefineAngle=0, RelativeTolerance=0.65, SimplePlanes=True, Tolerance=0})
M = ClusterOutput(mesh)
